# Grasshopper definition Day1-6_GhPython.gh (Grasshopper 1.0.7)

# 4. GhPythonでRhino APIを操作する3つの方法
# ①rhinoscriptsyntax
# Python用に用意されたライブラリ
# https://developer.rhino3d.com/guides/rhinopython/python-rhinoscriptsyntax-introduction/
# 
# ②RhinoCommon
# .NETで開発されたクロスプラットフォームSDK
# https://developer.rhino3d.com/guides/rhinocommon/what-is-rhinocommon/
# 
# ③ghpythonlib
# GHコンポーネントをPythonで使えるようにしたNode-in-Codeライブラリ
# https://developer.rhino3d.com/guides/rhinopython/ghpython-call-components/
panel = Panel("8")
# 2. 型の指定
panel_2 = Panel("①何も設定しないと...")
panel_3 = Panel("特にCurve, Line, Rectangleなどの線分の場合タイプによって扱えるmethodが変わるので要注意")
start = Panel("0,0,0")
end = Panel("10,10,0")
panel_4 = Panel("②Point3dを指定")
start_2 = Panel("0,0,0")
end_2 = Panel("10,10,0")
# 3. ツリーの指定
panel_5 = Panel("①Item Access")
start_3 = Panel("0,0,0")
end_3 = Panel("10,10,0")
start_4 = Panel("0,0,0")
end_4 = Panel("10,10,0")
start_5 = Panel("0,0,0")
# この講習ではRhinoCommonを使って進めます
# https://developer.rhino3d.com/api/RhinoCommon/html/R_Project_RhinoCommon.htm
# →Twisted Tower演習
end_5 = Panel("10,10,0")
panel_6 = Panel("""Dictionaryをそのまま出力するとkeyのリストになってしまう
→[]で囲うとDectionaryとして持っていける""")
panel_7 = Panel("①List Access")
# 7. Rhino上のオブジェクトを操作したいとき
number_slider = Slider(20, range=1..100)
panel_9 = Panel("もとに戻すのを忘れないように")
# 5. 属性を持ったデータをコンポーネント間で共有する
panel_10 = Panel("①Dictionary")
panel_11 = Panel("受け取り側はリアルタイムには更新されない")
series = Series(Start=0, Step=1, Count="8")
series_2 = Series(Start=0, Step=1, Count="10")
# 6. GrasshopperファイルのGlobalに値を保存する
panel_12 = Panel("key1")
series_3 = Series(Start=0, Step=1, Count="8")
panel_13 = Panel("②Class")
series_4 = Series(Start=0, Step=1, Count="10")
series_5 = Series(Start=0, Step=1, Count=panel)
series_6 = Series(Start=0, Step=1, Count="10")
python = GhPythonScript()  # -> out, dictionary, dictionary_2
# ---------- python: Python ----------
dictionary = {"key1": 1, "key2": 2, "key3": 3}
print(dictionary)
dictionary_ = [dictionary]
# ---------- end python ----------
python_2 = GhPythonScript()  # -> out, cls
# ---------- python_2: Python ----------
class Sample:
    def __init__(self, value1, value2, value3):
        self.key1 = value1
        self.key2 = value2
        self.key3 = value3

cls = Sample(1,2,3)
print(cls)
# ---------- end python_2 ----------
# 1. GhPythonコンポーネント
python_3 = GhPythonScript()  # -> Out, A
pt = Point(start)
pt_2 = Point(end)
pt_3 = Point(start_2)
panel_14 = Panel(series_2)
panel_15 = Panel(series)
panel_16 = Panel(series_4)
panel_17 = Panel(series_3)
panel_18 = Panel(series_6)
panel_19 = Panel(series_5)
rhinoscriptsyntax = GhPythonScript(start=start_3, end=end_3)  # -> out, line; inputs start: Point3d, end: Point3d
# ---------- rhinoscriptsyntax: Python ----------
import rhinoscriptsyntax as rs

line = rs.AddLine(start,end)
print(type(line))
# ---------- end rhinoscriptsyntax ----------
rhinocommon = GhPythonScript(start=start_4, end=end_4)  # -> out, line; inputs start: Point3d, end: Point3d
# ---------- rhinocommon: Python ----------
import Rhino.Geometry as rg

line = rg.Line(start,end)
print(type(line))
# ---------- end rhinocommon ----------
ghpythonlib = GhPythonScript(start=start_5, end=end_5)  # -> out, line; inputs end: Point3d
# ---------- ghpythonlib: Python ----------
import ghpythonlib.components as gh

line = gh.Line(start,end)
print(type(line))
# ---------- end ghpythonlib ----------
python_4 = GhPythonScript(key=panel_12, value=Slider(0.16, range=0..1))
# ---------- python_4: Python ----------
import scriptcontext as sc

sc.sticky[key] = value
# ---------- end python_4 ----------
python_5 = GhPythonScript(start=pt, end=pt_2)  # -> out, line
# ---------- python_5: Python ----------
import Rhino.Geometry as rg

print("startのtype: {}".format(type(start)))
print("endのtype: {}".format(type(end)))

line = rg.Line(start,end)
# ---------- end python_5 ----------
panel_20 = Panel(python.out)
panel_21 = Panel(python.dictionary)
python_6 = GhPythonScript(start=pt_3, end=end_2)  # -> out, line; inputs start: Point3d, end: Point3d; same code as python_5
panel_22 = Panel(python.dictionary_2)
python_7 = GhPythonScript(x=number_slider, y=Slider(39, range=1..100), z=Slider(15, range=1..100))  # -> out, box; disabled
# ---------- python_7: Python ----------
import Rhino
import Rhino.Geometry as rg
import scriptcontext as sc

sc.doc = Rhino.RhinoDoc.ActiveDoc

x_size = rg.Interval(0,x)
y_size = rg.Interval(0,y)
z_size = rg.Interval(0,z)
box = rg.Box(rg.Plane.WorldXY, x_size, y_size, z_size)

obj = sc.doc.Objects.AddBox(box)

sc.doc = ghdoc
# ---------- end python_7 ----------
panel_23 = Panel(python_2.out)
panel_24 = Panel(python_2.cls)
python_8 = GhPythonScript(x=panel_14, y=graft(panel_15))  # -> out, a
# ---------- python_8: Python ----------
import Rhino.Geometry as rg

a = rg.Point3d(x,y,0)
# ---------- end python_8 ----------
crossref = CrossReference(ListA=panel_18, ListB=panel_19, CrossMode=1)  # -> ListA, ListB
python_9 = GhPythonScript(x=panel_16, y=panel_17)  # -> out, a; inputs x: list, y: list
# ---------- python_9: Python ----------
import Rhino.Geometry as rg

a = []
for i in x:
    for j in y:
        a.append(rg.Point3d(i,j,0))
# ---------- end python_9 ----------
lng = ListLength(List=panel_18)
panel_25 = Panel("""・ダブルクリックでエディターを開く
・コンポーネント名右クリックでコンポーネント名の変更など
・入出力の増減""")
lng_2 = ListLength(List=panel_18)
panel_26 = Panel(rhinoscriptsyntax.out)
panel_27 = Panel(rhinoscriptsyntax.line)
panel_28 = Panel(rhinocommon.out)
panel_29 = Panel(rhinocommon.line)
panel_30 = Panel(ghpythonlib.out)
panel_31 = Panel(ghpythonlib.line)
partition = PartitionList(List=crossref.ListA, Size=lng)
partition_2 = PartitionList(List=crossref.ListB, Size=lng_2)
panel_32 = Panel(python_5.out)
panel_33 = Panel(python_5.line)
panel_34 = Panel(python_6.out)
panel_35 = Panel(python_6.line)
panel_36 = Panel(python_8.a)
panel_37 = Panel(python_9.a)
python_10 = GhPythonScript()  # -> out, rhino_obj
# ---------- python_10: Python ----------
import scriptcontext as sc
import Rhino

sc.doc = Rhino.RhinoDoc.ActiveDoc

rhino_obj = sc.doc.Objects.FindByLayer("デフォルト")[0].Geometry

sc.doc = ghdoc
# ---------- end python_10 ----------
python_11 = GhPythonScript(x=partition, y=partition_2)  # -> out, a; inputs x: tree, y: tree
# ---------- python_11: Python ----------
import Rhino.Geometry as rg
import ghpythonlib.treehelpers as th

x_list = th.tree_to_list(x)[0]
y_list = th.tree_to_list(y)[0]

a_list = []
for i, x_l in enumerate(x_list):
    pt_list = []
    for j, x_pt in enumerate(x_l):
        pt_list.append(rg.Point3d(x_pt,y_list[i][j],0))
    a_list.append(pt_list)

a = th.list_to_tree(a_list)
# ---------- end python_11 ----------
python_12 = GhPythonScript(key="key1")  # -> out, a
# ---------- python_12: Python ----------
import scriptcontext as sc

a = sc.sticky[key]
# ---------- end python_12 ----------
panel_38 = Panel("""◯
・入力が雑でも融通がきく
・簡単
☓
・処理が遅い
・タイプの細かい制御が難しい""")
panel_39 = Panel("""◯
・処理速度が早い
・C#でも同じように書ける
☓
・タイプによってmethodが違うので扱いづらい時がある""")
panel_40 = Panel("""◯
・GHが使えれば使える
・GH同様入力タイプの融通がきく
☓
・原始的な関数がない""")
python_13 = GhPythonScript(d=python.dictionary_2, key="key1")  # -> out, a
# ---------- python_13: Python ----------
a = d[key]
# ---------- end python_13 ----------
python_14 = GhPythonScript(d=python_2.cls)  # -> out, a
# ---------- python_14: Python ----------
a = d.key1
# ---------- end python_14 ----------
panel_41 = Panel(python_11.a)
panel_42 = Panel(python_12.a)
panel_43 = Panel("""入力の1つの値を1つのItemとして扱う
→ListやTreeを入れた場合個数分処理が走る""")
panel_44 = Panel(python_10.rhino_obj)
panel_45 = Panel("""入力を1つのListとして扱う
→Listを入れた場合は1回処理が走る
→Treeを入れた場合はBranch数分処理が走る""")
panel_46 = Panel(python_13.a)
panel_47 = Panel(python_14.a)
panel_48 = Panel("""入力を1つのTreeとして扱う
→Treeを入れた場合は1回処理が走る

※Tree↔Python多次元配列の変換処理が必要""")
