# Grasshopper definition TwistedTower.gh (Grasshopper 1.0.7)

mullion_radius = Slider(0.05, range=0..1)
mullion_pitch = Slider(3, range=1..50)
angle_degree = Slider(3.5, range=0..90)
floor_count = Slider(30, range=1..50)
floor_height = Slider(4, range=1..50)
floor_shape = Curve(reparameterize(<curve referenced from the Rhino model>))
python = GhPythonScript(
    floor_shape=floor_shape,
    floor_count=floor_count,
    angle_degree=angle_degree,
    floor_height=floor_height,
    mullion_radius=mullion_radius,
    mullion_pitch=mullion_pitch)  # -> out, floor_crvs, floor_srfs, curtain_wall, mullions; inputs floor_shape: Curve, floor_count: Int32
# ---------- python: Python ----------
# -*- coding: utf-8 -*-
import Rhino.Geometry as rg
import math

floor_crvs = []
floor_srfs = []
mullion_points = []
mullions = []

def get_mullion_points(crv):
    points = []
    # ポリラインに変換
    pline = crv.ToPolyline()
    # セグメント数
    segment_count = pline.SegmentCount
    for i in range(segment_count):
        # セグメントを取得
        segment = pline.SegmentAt(i)
        # マリオンの数を計算
        mullion_count = math.ceil(segment.Length / mullion_pitch)
        # マリオンを配置するパラメータ
        params = [j/(mullion_count-1) for j in range(int(mullion_count))]
        # リストに追加（頂点の重複を削除）
        points.extend([segment.PointAt(p) for p in params[1:]])
    return points

if __name__ == "__main__":
    # フロアの中心点
    center_pt = rg.AreaMassProperties.Compute(floor_shape).Centroid

    for i in range(floor_count):
        # Move 
        mov = rg.Transform.Translation(0,0,i*floor_height)
        # Rotate
        rot = rg.Transform.Rotation(math.radians(i*angle_degree), center_pt)
        # Move+Rotate
        xform = rg.Transform.Multiply(mov, rot)
        # Floorをコピー
        new_floor = floor_shape.Duplicate()
        # Transform
        new_floor.Transform(xform)
        # リストに追加
        floor_crvs.append(new_floor)
        # Surfaceに変換
        new_floor_srf = rg.Brep.CreatePlanarBreps(new_floor, 0.001)[0]
        # リストに追加
        floor_srfs.append(new_floor_srf)
        # マリオンのポイント
        mullion_points.append(get_mullion_points(new_floor))
    
    # カーテンウォールをロフトで作る
    curtain_wall = rg.Brep.CreateFromLoft(floor_crvs, 
                                            rg.Point3d.Unset,
                                            rg.Point3d.Unset,
                                            rg.LoftType.Straight,
                                            False)[0]
                                            
    # マリオンを作る
    for i in range(1, floor_count):
        bottom_points = mullion_points[i-1]
        top_points = mullion_points[i]
        for j, btm_pt in enumerate(bottom_points):
            line = rg.Line(btm_pt, top_points[j])
            mullion_base = rg.Circle(btm_pt, mullion_radius).ToNurbsCurve()
            mullion = rg.Brep.CreateFromSweep(line.ToNurbsCurve(),
                                                [mullion_base], 
                                                True, 
                                                0.001)[0]
            mullions.append(mullion)
# ---------- end python ----------
preview = CustomPreview(Geometry=python.curtain_wall, Material=ColourSwatch(SwatchColor=RGBA(148, 255, 255, 88)))
preview_2 = CustomPreview(Geometry=[python.floor_srfs, python.mullions], Material=ColourSwatch(SwatchColor=RGB(255, 255, 255)))
