# Grasshopper definition OfficeLayout.gh (Grasshopper 1.0.7)

unit = Panel("1000")

# ---- group: Desk
partition = Brep([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])

# ----
desk = Brep([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])
mesh = MeshBrep(
    Brep=partition,
    Settings={GridMaxCount=0, GridMinCount=16, JaggedSeams=False, MaxEdgeLength=0, MinEdgeLength=0.0001, MinTolerance=0, Refine=True, RefineAngle=0, RelativeTolerance=0.65, SimplePlanes=True, Tolerance=0})
mesh_2 = MeshBrep(
    Brep=desk,
    Settings={GridMaxCount=0, GridMinCount=16, JaggedSeams=False, MaxEdgeLength=0, MinEdgeLength=0.0001, MinTolerance=0, Refine=True, RefineAngle=0, RelativeTolerance=0.65, SimplePlanes=True, Tolerance=0})
office_x = GetInteger(Slider(20, range=1..50), AtLeast=1, AtMost=1, Maximum=50, Minimum=1, TreeAccess=False)
desk_count = GetInteger(Slider(80, range=1..100), AtLeast=1, AtMost=1, Maximum=50, Minimum=1, TreeAccess=False)
office_y = GetInteger(Slider(45, range=1..50), AtLeast=1, AtMost=1, Maximum=50, Minimum=1, TreeAccess=False)
void_count = GetInteger(Slider(7, range=1..50), AtLeast=1, AtMost=1, Maximum=50, Minimum=1, TreeAccess=False)
partition_count = GetInteger(Slider(30, range=1..50), AtLeast=1, AtMost=1, Maximum=50, Minimum=1, TreeAccess=False)
void_size = GetInteger(Slider(6, range=1..50), AtLeast=1, AtMost=1, Maximum=50, Minimum=1, TreeAccess=False)
desk_unit = GetInteger(Slider(2, range=1..50), AtLeast=1, AtMost=1, Maximum=50, Minimum=1, TreeAccess=False)
partition_unit = GetInteger(Slider(3, range=1..50), AtLeast=1, AtMost=1, Maximum=50, Minimum=1, TreeAccess=False)
unit_2 = Number(unit)
mjoin = MeshJoin(Meshes=mesh)
mjoin_2 = MeshJoin(Meshes=mesh_2)
create_instances = GhPythonScript(
    unit=unit_2,
    X=office_x,
    Y=office_y,
    void_count=void_count,
    void_size=void_size,
    desk_count=desk_count,
    desk_unit=desk_unit,
    partition_count=partition_count,
    partition_unit=partition_unit)  # -> out, office, cells, ids; inputs X: Int32, Y: Int32, void_count: Int32, void_size: Int32, desk_count: Int32, desk_unit: Int32, partition_count: Int32, partition_unit: Int32
# ---------- create_instances: Python ----------
import Rhino.Geometry as rg
import random, math

def generate_id(x, y):
    return "X{X}Y{Y}".format(X=str(x).zfill(2),Y=str(y).zfill(2))

def create_zone(x, y, office_x, office_y):
    if x < office_x/2:
        if y < office_y/2:
            zone = 0
        else:
            zone = 1
    else:
        if y < office_y/2:
            zone = 2
        else:
            zone = 3
    return zone

class Cell:
    def __init__(self, x, y):
        self.x = x
        self.y = y
        self.base_pt = rg.Point3d(self.x*unit+unit/2, self.y*unit+unit/2, 0)
        self.base = rg.Plane(self.base_pt, rg.Vector3d(1,0,0), rg.Vector3d(0,1,0))
        self.id = generate_id(self.x, self.y)
        self.status = True
        self.type = "other"
        self.zone = None
        self.accessibility = "NaN"
        self.communication = []
        self.communication_score = "NaN"
        self.communication_line = []
        
    def make_space(self, space_type, direction):
        self.status = False
        self.type = space_type
        if direction:
            self.base.Rotate(math.pi/2, rg.Vector3d(0,0,1),self.base.Origin)

class Office:
    def __init__(self, x, y, unit, 
                    void_count, void_size, 
                    desk_count, desk_unit,
                    partition_count, partiton_unit):
        self.x = x
        self.y = y
        self.unit = unit
        self.base_pt = rg.Point3d(unit/2, unit/2, 0)
        self.base = rg.Plane(self.base_pt, rg.Vector3d(1,0,0), rg.Vector3d(0,1,0))
        self.void_count = void_count
        self.void_size = void_size
        self.desk_count = desk_count
        self.desk_unit = desk_unit
        self.partition_count = partition_count
        self.partition_unit = partition_unit
        self.cells = {}
        self.create_cells()
    
    def create_cells(self):
        for x in range(self.x):
            for y in range(self.y):
                cell = Cell(x,y)
                cell.zone = create_zone(x, y, self.x, self.y)
                self.cells[cell.id] = cell
                
    def create_space(self, size_x, size_y, direction, space_type):
        x = random.randint(0, self.x-size_x)
        y = random.randint(0, self.y-size_y)
        space_cells = []
        for i in range(size_x):
            for j in range(size_y):
                space_cells.append([x+i,y+j])
        bool_space = []
        for space in space_cells:
            id = generate_id(space[0], space[1])
            bool_space.append(self.cells[id].status)
        if all(bool_space):
            for space in space_cells:
                id = generate_id(space[0], space[1])
                self.cells[id].make_space(space_type, direction)
            return "Success"
        else:
            return "Failed"


if __name__ == "__main__":
    # Office
    office = Office(X, Y, unit, 
                    void_count, void_size, 
                    desk_count, desk_unit,
                    partition_count, partition_unit)
            
    ids = office.cells.keys()
    cells = [office.cells]
# ---------- end create_instances ----------

officebase = GhPythonScript(office=create_instances.office)  # -> out, base
# ---------- officebase: Python ----------
if __name__ == "__main__":
    base = office.base
# ---------- end officebase ----------
division = Division(A=unit_2, B=2)
neg = Negative(Value=division)
dom = ConstructDomain(DomainStart=neg, DomainEnd=division)
rectangle = Rectangle(Plane=officebase.base, XSize=dom, YSize=dom, Radius=0)  # -> Rectangle, Length

create_space = GhPythonScript(office=create_instances.office)  # -> out, office
# ---------- create_space: Python ----------
import random

if __name__ == "__main__":
    size_x = office.void_size
    size_y = office.void_size
    for i in range(office.void_count):
        while i<100:
            result = office.create_space(size_x, size_y, True, "void")
            if result == "Success":
                break
            else:
                i+=1
        else:
            raise Exception("Void - Failed")
            
    for i in range(office.desk_count):
        x_or_y = random.random() < 0.5
        if x_or_y:
            size_x = office.desk_unit
            size_y = 1
        else:
            size_x = 1
            size_y = office.desk_unit

        while i<100:
            result = office.create_space(size_x, size_y, x_or_y, "desk")
            if result == "Success":
                break
            else:
                i+=1
        else:
            raise Exception("Desk - Failed")


    for i in range(office.partition_count):
        x_or_y = random.random() < 0.5
        if x_or_y:
            size_x = office.partition_unit
            size_y = 1
        else:
            size_x = 1
            size_y = office.partition_unit
        while i<100:
            result = office.create_space(size_x, size_y, x_or_y, "partition")
            if result == "Success":
                break
            else:
                i+=1
        else:
            raise Exception("Partition - Failed")
# ---------- end create_space ----------
analyze_accessibility = GhPythonScript(office=create_space.office)  # -> out, office
# ---------- analyze_accessibility: Python ----------
import Rhino.Geometry as rg

if __name__ == "__main__":
    desk_pts = []
    for key, cell in office.cells.items():
        if cell.type == "desk":
            desk_pts.append(cell.base_pt)
    point_cloud = rg.PointCloud(desk_pts)
    for key, cell in office.cells.items():
        if cell.type in ["void", "other"]:
            res = point_cloud.ClosestPoint(cell.base_pt)
            if res > -1:
                dist = cell.base_pt.DistanceTo(desk_pts[res])
                office.cells[key].accessibility = dist
# ---------- end analyze_accessibility ----------
analyze_communication = GhPythonScript(office=analyze_accessibility.office)  # -> out, office
# ---------- analyze_communication: Python ----------
import Rhino.Geometry as rg
import math
import itertools

search_range = 3000

def generate_id(x, y):
    return "X{X}Y{Y}".format(X=str(x).zfill(2),Y=str(y).zfill(2))

def create_range(coordinate, range_unit, office_size):
    l = range(-range_unit+coordinate, range_unit+coordinate+1)
    l = [item for item in l if item < office_size and item >= 0]
    return l

def IsBlockByPartition(cells, key_a, key_b, unit):
    line = rg.Line(cells[key_a].base_pt, cells[key_b].base_pt)
    x_a = cells[key_a].x
    y_a = cells[key_a].y
    x_b = cells[key_b].x
    y_b = cells[key_b].y
    x_range = range(min([x_a,x_b]), max([x_a,x_b])+1)
    y_range = range(min([y_a,y_b]), max([y_a,y_b])+1)
    search_cell = list(itertools.product(x_range, y_range))
    search_cell.remove((x_a, y_a))
    search_cell.remove((x_b, y_b))
    path_cells = []
    for search in search_cell:
        id = generate_id(search[0],search[1])
        cell = cells[id]
        interval = rg.Interval(-unit/2, unit/2)
        rect = rg.Rectangle3d(cell.base, interval, interval)
        intersect = intersect_line_rect(line, rect)
        if intersect.Count > 1:
            path_cells.append(id)
    for cell_id in path_cells:
        if cells[cell_id].type == "partition":
            return True
    else:
        return False

def intersect_line_rect(line, rect):
    rect_curve = rect.ToNurbsCurve()
    line_curve = line.ToNurbsCurve()
    res = rg.Intersect.Intersection.CurveCurve(line_curve, rect_curve, 0.01, 0.01)
    return res

if __name__ == "__main__":
    range_unit = int(math.ceil(search_range / office.unit))

    for key, cell in office.cells.items():
        if cell.type == "desk":
            office.cells[key].communication_score = 0
            
            x_range = create_range(cell.x, range_unit, office.x)
            y_range = create_range(cell.y, range_unit, office.y)
            
            search_cell = list(itertools.product(x_range, y_range))
            search_cell.remove((cell.x, cell.y))
            
            for search in search_cell:
                id = generate_id(search[0],search[1])
                if office.cells[id].type == "desk":
                    block_by_partition = IsBlockByPartition(office.cells, key, id, office.unit)
                    if not(block_by_partition):
                        office.cells[key].communication_score += 1
                        office.cells[key].communication.append(id)
                        office.cells[key].communication_line.append(rg.Line(cell.base_pt, office.cells[id].base_pt).ToNurbsCurve())
        else:
            pass
# ---------- end analyze_communication ----------

extract_cells_to_list = GhPythonScript(office=analyze_communication.office)  # -> out, id, x, y, zone, cell_type, base, accessibility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
# ---------- extract_cells_to_list: Python ----------
import ghpythonlib.treehelpers as th

if __name__ == "__main__":
    id = []
    cell_type = []
    x = []
    y = []
    zone = []
    base = []
    accessibility = []
    communication = []
    communication_score = []
    communication_line = []
    for key, cell in office.cells.items():
        id.append(key)
        x.append(cell.x)
        y.append(cell.y)
        zone.append(cell.zone)
        cell_type.append(cell.type)
        base.append(cell.base)
        accessibility.append(cell.accessibility)
        communication.append(cell.communication)
        communication_score.append(cell.communication_score)
        communication_line.append(cell.communication_line)
    communication = th.list_to_tree(communication)
    communication_line = th.list_to_tree(communication_line)
# ---------- end extract_cells_to_list ----------
extract_cells = GhPythonScript(office=analyze_accessibility.office)  # -> out, void, desk, partition, other
# ---------- extract_cells: Python ----------
if __name__ == "__main__":
    void = []
    desk = []
    partition = []
    other = []
    for key, val in office.cells.items():
        if val.type == "void":
            void.append(val)
        elif val.type == "desk":
            desk.append(val)
        elif val.type == "partition":
            partition.append(val)
        else:
            other.append(val)
# ---------- end extract_cells ----------

# ---- group: RH_OUT:Zone
data = Data(extract_cells_to_list.zone)

# ---- group: RH_OUT:Type
data_2 = Data(extract_cells_to_list.cell_type)

# ---- group: RH_OUT:ID
data_3 = Data(extract_cells_to_list.id)

# ---- group: RH_OUT:X
data_4 = Data(extract_cells_to_list.x)

# ---- group: RH_OUT:Y
data_5 = Data(extract_cells_to_list.y)

# ----
base = GhPythonScript(cells=create_instances.cells)  # -> out, base
# ---------- base: Python ----------
import Rhino.Geometry as rg

if __name__ == "__main__":
    cells_list = cells.values()
    base = [cell.base for cell in cells_list]
# ---------- end base ----------
orient = Orient(Geometry=rectangle.Rectangle, Source=officebase.base, Target=base.base)  # -> Geometry, Transform
area = Area(Geometry=orient.Geometry)  # -> Area, Centroid
size = Panel("100")
tag = TextTag3D(
    Location=flatten(area.Centroid),
    Text=create_instances.ids,
    Size=size,
    Colour=ColourSwatch(SwatchColor=RGB(0, 0, 0)),
    Justification=5)

# ---- group: RH_OUT:Communication
data_6 = Data(extract_cells_to_list.communication)

# ---- group: RH_OUT:Communication_Line
data_7 = Data(extract_cells_to_list.communication_line)

# ---- group: RH_OUT:Communication_Count
data_8 = Data(extract_cells_to_list.communication_score)

# ---- group: RH_OUT:Accessibility
data_9 = Data(extract_cells_to_list.accessibility)

# ----
bnd = Bounds(Numbers=extract_cells_to_list.communication_score)
dedomain = DeconstructDomain(Domain=bnd)  # -> Start, End
gradient = Gradient(
    LowerLimit=dedomain.End,
    UpperLimit=dedomain.Start,
    Parameter=extract_cells_to_list.communication_score,
    stops=[0: RGB(234, 38, 0), 0.25: RGB(234, 126, 0), 0.5: RGB(254, 244, 84), 0.75: RGB(173, 203, 249), 1: RGB(75, 107, 169)])
orient_2 = Orient(Geometry=rectangle.Rectangle, Source=officebase.base, Target=extract_cells_to_list.base)  # -> Geometry, Transform
mesh_3 = MeshBrep(
    Brep=orient_2.Geometry,
    Settings={GridMaxCount=0, GridMinCount=16, JaggedSeams=False, MaxEdgeLength=0, MinEdgeLength=0.0001, MinTolerance=0, Refine=True, RefineAngle=0, RelativeTolerance=0.65, SimplePlanes=True, Tolerance=0})
nullrep = ReplaceNulls(Items=gradient, Replacements=ColourSwatch(SwatchColor=RGB(196, 196, 196)))  # -> Items, Count
mcol = MeshColours(Mesh=graft(mesh_3), Colours=graft(nullrep.Items))  # -> flatten(Mesh)
preview = CustomPreview(Geometry=data_7, Material=ColourSwatch(SwatchColor=RGB(255, 255, 255)))

# ---- group: RH_OUT:Communication_Plane
data_10 = Data(mcol)

# ----
preview_2 = CustomPreview(
    Geometry=data_10,
    Material={diffuse=RGB(221, 160, 221), emission=RGB(66, 48, 66), shine=0.5, specular=RGB(255, 255, 255), transparency=0})

bnd_2 = Bounds(Numbers=extract_cells_to_list.accessibility)
dedomain_2 = DeconstructDomain(Domain=bnd_2)  # -> Start, End
gradient_2 = Gradient(
    LowerLimit=dedomain_2.Start,
    UpperLimit=dedomain_2.End,
    Parameter=extract_cells_to_list.accessibility,
    stops=[0: RGB(234, 38, 0), 0.25: RGB(234, 126, 0), 0.5: RGB(254, 244, 84), 0.75: RGB(173, 203, 249), 1: RGB(75, 107, 169)])
orient_3 = Orient(Geometry=rectangle.Rectangle, Source=officebase.base, Target=extract_cells_to_list.base)  # -> Geometry, Transform
mesh_4 = MeshBrep(
    Brep=orient_3.Geometry,
    Settings={GridMaxCount=0, GridMinCount=16, JaggedSeams=False, MaxEdgeLength=0, MinEdgeLength=0.0001, MinTolerance=0, Refine=True, RefineAngle=0, RelativeTolerance=0.65, SimplePlanes=True, Tolerance=0})
nullrep_2 = ReplaceNulls(Items=gradient_2, Replacements=ColourSwatch(SwatchColor=RGB(196, 196, 196)))  # -> Items, Count
mcol_2 = MeshColours(Mesh=graft(mesh_4), Colours=graft(nullrep_2.Items))  # -> flatten(Mesh)

# ---- group: RH_OUT:Accessibility_Plane
data_11 = Data(mcol_2)

# ----
preview_3 = CustomPreview(
    Geometry=data_11,
    Material={diffuse=RGB(221, 160, 221), emission=RGB(66, 48, 66), shine=0.5, specular=RGB(255, 255, 255), transparency=0})

base_2 = GhPythonScript(cell=extract_cells.void)  # -> out, base
# ---------- base_2: Python ----------
if __name__ == "__main__":
    base = cell.base
# ---------- end base_2 ----------
orient_4 = Orient(Geometry=rectangle.Rectangle, Source=officebase.base, Target=base_2.base)  # -> Geometry, Transform
boundary = BoundarySurfaces(Edges=orient_4.Geometry)
mesh_5 = MeshBrep(
    Brep=boundary,
    Settings={GridMaxCount=0, GridMinCount=16, JaggedSeams=False, MaxEdgeLength=0, MinEdgeLength=0.0001, MinTolerance=0, Refine=True, RefineAngle=0, RelativeTolerance=0.65, SimplePlanes=True, Tolerance=0})
mcol_3 = MeshColours(Mesh=mesh_5, Colours=ColourSwatch(SwatchColor=RGB(110, 110, 110)))

# ---- group: RH_OUT:Void_Plane
data_12 = Data(mcol_3)

# ----
preview_4 = CustomPreview(
    Geometry=data_12,
    Material={diffuse=RGB(221, 160, 221), emission=RGB(66, 48, 66), shine=0.5, specular=RGB(255, 255, 255), transparency=0})

base_3 = GhPythonScript(cell=extract_cells.other)  # -> out, base; same code as base_2
orient_5 = Orient(Geometry=rectangle.Rectangle, Source=officebase.base, Target=base_3.base)  # -> Geometry, Transform
boundary_2 = BoundarySurfaces(Edges=orient_5.Geometry)
mesh_6 = MeshBrep(
    Brep=boundary_2,
    Settings={GridMaxCount=0, GridMinCount=16, JaggedSeams=False, MaxEdgeLength=0, MinEdgeLength=0.0001, MinTolerance=0, Refine=True, RefineAngle=0, RelativeTolerance=0.65, SimplePlanes=True, Tolerance=0})
mcol_4 = MeshColours(Mesh=mesh_6, Colours=ColourSwatch(SwatchColor=RGB(199, 199, 199)))

# ---- group: RH_OUT:Other_Plane
data_13 = Data(mcol_4)

# ----
preview_5 = CustomPreview(
    Geometry=data_13,
    Material={diffuse=RGB(221, 160, 221), emission=RGB(66, 48, 66), shine=0.5, specular=RGB(255, 255, 255), transparency=0})

base_4 = GhPythonScript(cell=extract_cells.desk)  # -> out, base; same code as base_2
swatch = ColourSwatch(SwatchColor=RGBA(21, 0, 255, 100))
orient_6 = Orient(Geometry=rectangle.Rectangle, Source=officebase.base, Target=base_4.base)  # -> Geometry, Transform
orient_7 = Orient(Geometry=mjoin_2, Source=officebase.base, Target=base_4.base)  # -> Geometry, Transform
boundary_3 = BoundarySurfaces(Edges=orient_6.Geometry)
mesh_7 = MeshBrep(
    Brep=boundary_3,
    Settings={GridMaxCount=0, GridMinCount=16, JaggedSeams=False, MaxEdgeLength=0, MinEdgeLength=0.0001, MinTolerance=0, Refine=True, RefineAngle=0, RelativeTolerance=0.65, SimplePlanes=True, Tolerance=0})
mcol_5 = MeshColours(Mesh=mesh_7, Colours=swatch)
mcol_6 = MeshColours(Mesh=orient_7.Geometry, Colours=swatch)

# ---- group: RH_OUT:Desk_Objects
data_14 = Data(mcol_6)

# ---- group: RH_OUT:Desk_Plane
data_15 = Data(mcol_5)

# ----
preview_6 = CustomPreview(
    Geometry=data_14,
    Material={diffuse=RGB(221, 160, 221), emission=RGB(66, 48, 66), shine=0.5, specular=RGB(255, 255, 255), transparency=0})
preview_7 = CustomPreview(
    Geometry=data_15,
    Material={diffuse=RGB(221, 160, 221), emission=RGB(66, 48, 66), shine=0.5, specular=RGB(255, 255, 255), transparency=0})

base_5 = GhPythonScript(cell=extract_cells.partition)  # -> out, base; same code as base_2
swatch_2 = ColourSwatch(SwatchColor=RGBA(255, 0, 0, 100))
orient_8 = Orient(Geometry=mjoin, Source=officebase.base, Target=base_5.base)  # -> Geometry, Transform
orient_9 = Orient(Geometry=rectangle.Rectangle, Source=officebase.base, Target=base_5.base)  # -> Geometry, Transform
mcol_7 = MeshColours(Mesh=orient_8.Geometry, Colours=swatch_2)
boundary_4 = BoundarySurfaces(Edges=orient_9.Geometry)
mesh_8 = MeshBrep(
    Brep=boundary_4,
    Settings={GridMaxCount=0, GridMinCount=16, JaggedSeams=False, MaxEdgeLength=0, MinEdgeLength=0.0001, MinTolerance=0, Refine=True, RefineAngle=0, RelativeTolerance=0.65, SimplePlanes=True, Tolerance=0})
mcol_8 = MeshColours(Mesh=mesh_8, Colours=swatch_2)

# ---- group: RH_OUT:Partition_Objects
data_16 = Data(mcol_7)

# ---- group: RH_OUT:Partition_Plane
data_17 = Data(mcol_8)

# ----
preview_8 = CustomPreview(
    Geometry=data_16,
    Material={diffuse=RGB(221, 160, 221), emission=RGB(66, 48, 66), shine=0.5, specular=RGB(255, 255, 255), transparency=0})
preview_9 = CustomPreview(
    Geometry=data_17,
    Material={diffuse=RGB(221, 160, 221), emission=RGB(66, 48, 66), shine=0.5, specular=RGB(255, 255, 255), transparency=0})
