# Grasshopper definition OfficeLayout_HopsClient.gh (Grasshopper 1.0.7)
# plug-ins: Hops

office_x = GetInteger(Slider(20, range=1..50), AtLeast=1, AtMost=1, Maximum=50, Minimum=1, TreeAccess=False)
desk_count = GetInteger(Slider(50, range=1..100), AtLeast=1, AtMost=1, Maximum=50, Minimum=1, TreeAccess=False)
office_y = GetInteger(Slider(45, range=1..50), AtLeast=1, AtMost=1, Maximum=50, Minimum=1, TreeAccess=False)
void_count = GetInteger(Slider(5, range=1..50), AtLeast=1, AtMost=1, Maximum=50, Minimum=1, TreeAccess=False)
partition_count = GetInteger(Slider(30, range=1..50), AtLeast=1, AtMost=1, Maximum=50, Minimum=1, TreeAccess=False)
void_size = GetInteger(Slider(6, range=1..50), AtLeast=1, AtMost=1, Maximum=50, Minimum=1, TreeAccess=False)
desk_unit = GetInteger(Slider(2, range=1..50), AtLeast=1, AtMost=1, Maximum=50, Minimum=1, TreeAccess=False)
partition_unit = GetInteger(Slider(3, range=1..50), AtLeast=1, AtMost=1, Maximum=50, Minimum=1, TreeAccess=False)
hops = Hops(
    Office_X=office_x,
    Office_Y=office_y,
    Void_Count=void_count,
    Void_Size=void_size,
    Desk_Count=desk_count,
    Desk_Unit=desk_unit,
    Partition_Count=partition_count,
    Partition_Unit=partition_unit,
    CacheResultsInMemory=True,
    CacheSolveResults=True,
    RemoteDefinitionLocation="C:\Users\t1000\Desktop\DesignFutures2022-DataDrivenDesign-with-Python\Day2\gh\OfficeLayout.gh",
    RemoteSolveVersion=(0, 1, 0),
    ShowInput_Enabled=False,
    ShowInput_Path=False,
    SynchronousSolve=True)  # -> Void_Plane, ID, X, Y, Other_Plane, Zone, Type, Desk_Objects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
preview = CustomPreview(
    Geometry=[hops.Void_Plane, hops.Other_Plane, hops.Desk_Plane, hops.Partition_Plane],
    Material={diffuse=RGB(221, 160, 221), emission=RGB(66, 48, 66), shine=0.5, specular=RGB(255, 255, 255), transparency=0})
preview_2 = CustomPreview(
    Geometry=hops.Accessibility_Plane,
    Material={diffuse=RGB(221, 160, 221), emission=RGB(66, 48, 66), shine=0.5, specular=RGB(255, 255, 255), transparency=0})
preview_3 = CustomPreview(
    Geometry=hops.Partition_Objects,
    Material={diffuse=RGB(221, 160, 221), emission=RGB(66, 48, 66), shine=0.5, specular=RGB(255, 255, 255), transparency=0})
preview_4 = CustomPreview(Geometry=[hops.Communication_Plane, hops.Communication_Line], Material=ColourSwatch(SwatchColor=RGB(255, 255, 255)))
preview_5 = CustomPreview(
    Geometry=hops.Desk_Objects,
    Material={diffuse=RGB(221, 160, 221), emission=RGB(66, 48, 66), shine=0.5, specular=RGB(255, 255, 255), transparency=0})
