# Grasshopper definition RhinoCompute_Sample.gh (Grasshopper 1.0.7)

A = GetNumber("1", AtLeast=1, AtMost=1, Maximum=1.797693135e+308, Minimum=-1.797693135e+308, TreeAccess=False)
B = GetNumber("5", AtLeast=1, AtMost=1, Maximum=1.797693135e+308, Minimum=-1.797693135e+308, TreeAccess=False)
addition = Addition(A=A, B=B)

# ---- group: RH_OUT:Result
num = Number(addition)
